# Grasshopper definition sunlight.ghx (Grasshopper 1.0.7)
# plug-ins: Wombat

epw = GetString(AtLeast=1, AtMost=1, TreeAccess=False)
start_m = GetInteger(AtLeast=1, AtMost=1, Maximum=2147483647, Minimum=-2147483648, TreeAccess=False)
start_d = GetInteger(AtLeast=1, AtMost=1, Maximum=2147483647, Minimum=-2147483648, TreeAccess=False)
start_h = GetInteger(AtLeast=1, AtMost=1, Maximum=2147483647, Minimum=-2147483648, TreeAccess=False)
end_m = GetInteger(AtLeast=1, AtMost=1, Maximum=2147483647, Minimum=-2147483648, TreeAccess=False)
end_d = GetInteger(AtLeast=1, AtMost=1, Maximum=2147483647, Minimum=-2147483648, TreeAccess=False)
end_h = GetInteger(AtLeast=1, AtMost=1, Maximum=2147483647, Minimum=-2147483648, TreeAccess=False)
context = GetGeometry(AtLeast=1, AtMost=2147483647, DeleteInput=False, Filter=1074004029, TreeAccess=True)
geo = GetGeometry(AtLeast=1, AtMost=1, DeleteInput=False, Filter=1074004029, TreeAccess=False)
analysisperiod = LBAnalysisPeriod(start_month=start_m, start_day=start_d, start_hour=start_h, end_month=end_m, end_day=end_d, end_hour=end_h)  # -> period, hoys, dates; plug-in component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
importepw = LBImportEPW(epw_file=epw)  # -> location, dry_bulb_temperature, dew_point_temperature, relative_humidity, wind_speed, wind_direction, direct_normal_rad, diffuse_horizontal_rad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; plug-in component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
area = Area(Geometry=geo)  # -> Area, Centroid
sunpath = LBSunPath(location=importepw.location, hoys=analysisperiod.hoys, center_pt=area.Centroid, scale=1)  # -> report, vectors, altitudes, azimuths, hoys, sun_pts, analemma, daily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; plug-in component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
number_slider = Slider(1, range=0..1)
number_slider_2 = Slider(2, range=0..10)
toggle = BooleanToggle(True)
skymatrix = LBCumulativeSkyMatrix(
    location=importepw.location,
    direct_rad=importepw.direct_normal_rad,
    diffuse_rad=importepw.diffuse_horizontal_rad,
    hoys=analysisperiod.hoys)  # -> report, sky_mtx; plug-in component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
directsunhours = LBDirectSunHours(
    vectors=flatten(sunpath.vectors),
    geometry=flatten(geo),
    context=flatten(context),
    grid_size=number_slider_2,
    offset_dist=number_slider,
    run=toggle)  # -> report, points, results, mesh, legend, title, int_mtx; plug-in component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
number_slider_3 = Slider(1, range=0..1)
incidentradiation = LBIncidentRadiation(
    sky_mtx=skymatrix.sky_mtx,
    geometry=flatten(geo),
    context=flatten(context),
    grid_size=number_slider_2,
    offset_dist=number_slider,
    run=toggle)  # -> report, points, results, total, mesh, legend, title, int_mtx; plug-in component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
lng = ListLength(List=directsunhours.points)
data = Data(flatten([directsunhours.legend, directsunhours.title]))
ma = MassAddition(Input=directsunhours.results)  # -> Result, PartialResults
lng_2 = ListLength(List=incidentradiation.points)
item = ListItem(List=data, Index=number_slider_3, Wrap=True)
cull_i = CullIndex(List=data, Indices=number_slider_3, Wrap=True)
number_slider_4 = Slider(1, range=0..1)
ma_2 = MassAddition(Input=incidentradiation.results)  # -> Result, PartialResults
division = Division(A=ma.Result, B=lng)
bbox = BoundingBox(Content=cull_i, Plane=PlaneXY(0, 0, 0))  # -> Box, Box_2
division_2 = Division(A=ma_2.Result, B=lng_2)
data_2 = Data(flatten([incidentradiation.legend, incidentradiation.title]))
area_2 = Area(Geometry=bbox.Box)  # -> Area, Centroid
text2crv = TextOutlines(TextContent=cull_i, Plane=area_2.Centroid, Face="Arial", Size=Slider(2, range=0..10), Bold=False, Italics=False)  # -> TextCurves, TextBoundingBox
item_2 = ListItem(List=data_2, Index=number_slider_4, Wrap=True)
cull_i_2 = CullIndex(List=data_2, Indices=number_slider_4, Wrap=True)
boundary = BoundarySurfaces(Edges=flatten(text2crv.TextCurves))
bbox_2 = BoundingBox(Content=cull_i_2, Plane=PlaneXY(0, 0, 0))  # -> Box, Box_2
mesh = Mesh(boundary)
area_3 = Area(Geometry=bbox_2.Box)  # -> Area, Centroid
text2crv_2 = TextOutlines(TextContent=cull_i_2, Plane=area_3.Centroid, Face="Arial", Size=Slider(2, range=0..10), Bold=False, Italics=False)  # -> TextCurves, TextBoundingBox
mcol = MeshColours(Mesh=mesh, Colours=ColourSwatch(SwatchColor=RGB(255, 255, 255)))
boundary_2 = BoundarySurfaces(Edges=flatten(text2crv_2.TextCurves))

# ---- group: RH_OUT:mesh
mesh_2 = Mesh(flatten([mcol, item, directsunhours.mesh]))

# ---- group: RH_OUT:total_sunlight
num = Number(division)

# ----
mesh_3 = Mesh(boundary_2)
mcol_2 = MeshColours(Mesh=mesh_3, Colours=ColourSwatch(SwatchColor=RGB(255, 255, 255)))

# ---- group: RH_OUT:radiation
mesh_4 = Mesh(flatten([mcol_2, item_2, incidentradiation.mesh]))

# ---- group: RH_OUT:total_radiation
num_2 = Number(division_2)
