# Grasshopper definition test_sunlight.ghx (Grasshopper 1.0.7)
# plug-ins: Wombat

panel = Panel("http://climate.onebuilding.org/WMO_Region_5_Southwest_Pacific/AUS_Australia/NSW_New_South_Wales/AUS_NSW_Sydney.Obs-Obsservatory.Hill.947680_TMYx.zip")
downloadepw = LBDownloadWeather(weather_URL=panel)  # -> epw_file, stat_file, ddy_file; plug-in component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
number_slider = Slider(1, range=0..10)
context = GetGeometry(AtLeast=1, AtMost=2147483647, DeleteInput=False, Filter=1074004029, TreeAccess=True)
importepw = LBImportEPW(epw_file=downloadepw.epw_file)  # -> location, dry_bulb_temperature, dew_point_temperature, relative_humidity, wind_speed, wind_direction, direct_normal_rad, diffuse_horizontal_rad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; plug-in component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
geo = GetGeometry(AtLeast=1, AtMost=2147483647, DeleteInput=False, Filter=1074004029, TreeAccess=True)
analysisperiod = LBAnalysisPeriod(
    start_month=Slider(6, range=0..10),
    start_day=number_slider,
    start_hour=Slider(14, range=0..100),
    end_month=number_slider,
    end_hour=number_slider,
    timestep=Slider(20, range=0..100))  # -> period, hoys, dates; plug-in component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
area = Area(Geometry=geo)  # -> Area, Centroid
sunpath = LBSunPath(location=importepw.location, hoys=analysisperiod.hoys, center_pt=area.Centroid, scale=1)  # -> report, vectors, altitudes, azimuths, hoys, sun_pts, analemma, daily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; plug-in component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
directsunhours = LBDirectSunHours(
    vectors=flatten(sunpath.vectors),
    geometry=flatten(geo),
    context=flatten(context),
    grid_size=Slider(2, range=0..10),
    offset_dist=Slider(1, range=0..1),
    run=Toggle(True))  # -> report, points, results, mesh, legend, title, int_mtx; plug-in component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
number_slider_2 = Slider(1, range=0..1)
lng = ListLength(List=directsunhours.points)
data = Data(flatten([directsunhours.legend, directsunhours.title]))
ma = MassAddition(Input=directsunhours.results)  # -> Result, PartialResults
item = ListItem(List=data, Index=number_slider_2, Wrap=True)
cull_i = CullIndex(List=data, Indices=number_slider_2, Wrap=True)
division = Division(A=ma.Result, B=lng)
bbox = BoundingBox(Content=cull_i, Plane=PlaneXY(0, 0, 0))  # -> Box, Box_2
area_2 = Area(Geometry=bbox.Box)  # -> Area, Centroid
text2crv = TextOutlines(TextContent=cull_i, Plane=area_2.Centroid, Face="Arial", Size=Slider(2, range=0..10), Bold=False, Italics=False)  # -> TextCurves, TextBoundingBox
boundary = BoundarySurfaces(Edges=flatten(text2crv.TextCurves))
mesh = Mesh(boundary)
mcol = MeshColours(Mesh=mesh, Colours=ColourSwatch(SwatchColor=RGB(255, 255, 255)))

# ---- group: RH_OUT:mesh
mesh_2 = Mesh(flatten([mcol, directsunhours.mesh, item]))

# ---- group: RH_OUT:total_sunlight
num = Number(division)
